# Grasshopper definition objexporttest.gh (Grasshopper 1.0.7)
# plug-ins: objexporttest

mesh = Mesh(<mesh referenced from the Rhino model>)
objexporttest = Objexporttest(Run=Toggle(True), SmoMesh=mesh, Environment="0607Test")
